# Grasshopper definition assembled_speckle.gh (Grasshopper 1.0.7)
# plug-ins: eleFront, Speckle 2, Rhino.Inside for Autodesk Revit, treesloth01, Nautilus

# ---- group: BIMSC-PROJECT
# Send a message to James M. to add
# new materials. This list will be updated
# for all groups to have a common material
# library and common material names.
panel = Panel("ELEMENTAL MARS")
bimsc_project = Text(panel)

# ---- group: RECEIVE MATERIALS
# RECIEVE
# MATERIALS
panel_2 = Panel("https://macad.speckle.xyz/projects/4975f9f0a8/models/d59a568f9e")
receive = Receive(
    Stream=panel_2,
    AutoReceive=False,
    CurrentComponentState="up_to_date",
    ExpandOutput=True,
    LastInfoMessage="James McBennett @ 03/02/2024 01:57:29: Materials 01-03-2024 (id:6ecf38526e)",
    ReceiveOnOpen=False,
    ReceivedCommitId="6ecf38526e",
    StreamWrapper="https://macad.speckle.xyz/projects/4975f9f0a8/models/d59a568f9e",
    selectedKitName="Objects")  # -> Info, Materials
dso = DeconstructSpeckleObject(SpeckleObject=receive.Materials, selectedKitName="Objects")  # -> Glass, Inflatable, Insulation, Mineral, Regolith, Site, Soil, Steel

# ---- group: FLOOR_LEVELS
# Set your 'Project' name, your 'Group'
# number, your 'Volume' Location that
# connect wirelessly.
series = Series(Start=0, Step=1, Count="5")
expression = Expression(x=series, Expression="Format(\"{0:00}\", x)")
concat = Concatenate(FragmentA="L", FragmentB=expression)  # -> simplify(graft(Result))
floor_levels = Text(concat)

# ----
# PHASES FOR HUMAN DEPLOYMENT
number_slider = Slider(2, range=1..8)
series_2 = Series(Start=1, Step=1, Count=number_slider)
item = ListItem(List=series_2, Index=0, Wrap=True)  # -> Item, Item1, Item2, Item3, Item4, Item5, Item6, Item7

# ----
# ASSEMBLY PHASES
number_slider_2 = Slider(8, range=1..8)
series_3 = Series(Start=1, Step=1, Count=number_slider_2)
item_2 = ListItem(List=series_3, Index=0, Wrap=True)  # -> Item, Item1, Item2, Item3, Item4, Item5, Item6, Item7

# ---- group: BIMSC-ORIGINATOR
bimsc_originator = Text("G06")

# ---- group: WorksForBrepsAndMeshes
list = ValueList({"Srf/Brep": 0, "Mesh": 1}, selected="Mesh")

# ---- group: BIMSC-VOLUME
bimsc_volume = Text("A4")

# ---- group: PHASE 1
num = Number(item.Item)

# ---- group: PHASE 2
num_2 = Number(item.Item1)

# ---- group: PHASE 3
num_3 = Number(item.Item2)  # disabled

# ---- group: PHASE 4
num_4 = Number(item.Item3)  # disabled

# ---- group: PHASE 5
num_5 = Number(item.Item4)  # disabled

# ---- group: PHASE 6
num_6 = Number(item.Item5)  # disabled

# ---- group: PHASE 8
num_7 = Number(item.Item7)  # disabled

# ---- group: PHASE 1
num_8 = Number(item_2.Item)

# ---- group: PHASE 2
num_9 = Number(item_2.Item1)

# ---- group: PHASE 3
num_10 = Number(item_2.Item2)

# ---- group: PHASE 4
num_11 = Number(item_2.Item3)

# ---- group: PHASE 5
num_12 = Number(item_2.Item4)

# ---- group: PHASE 6
num_13 = Number(item_2.Item5)

# ---- group: PHASE 7
num_14 = Number(item_2.Item6)

# ---- group: PHASE 8
num_15 = Number(item_2.Item7)

# ---- group: PHASE 7
num_16 = Number(item.Item6)  # disabled

# ---- group: All Blocks for Pods
# UNITS BLOCKS
panel_3 = Panel("Default")
reflay = ReferenceByLayer(LayerName=panel_3, lightweight=False)  # -> simplify(graft(Geometry))
block_info = GetBlockInfo(Block=reflay)  # -> Name, simplify(Plane), Transform, BlockType, FilePath, Active
pt = Point(block_info.Plane)
bang = ExplodeTree(Data=reflay)  # -> Branch0, Branch1, Branch2

# ----
panel_4 = Panel(reflay)

# ----
# UNITS
panel_5 = Panel("UnitsRawVolumes")
reflay_2 = ReferenceByLayer(LayerName=panel_5, lightweight=False)
volume = Volume(Geometry=reflay_2)  # -> Volume, Centroid
int = Integer(volume.Volume)
cset = CreateSet(List=int)  # -> Set, Map
cset_2 = CreateSet(List=cset.Map)  # -> Set, Map
mindex = MemberIndex(Set=cset.Map, Member=cset_2.Set)  # -> Index, Count
item_3 = ListItem(List=reflay_2, Index=mindex.Index, Wrap=True)  # -> simplify(Item)
bang_2 = ExplodeTree(Data=item_3)  # -> Branch0, Branch1

# ----
# PHASE 2 (50P) - HUMANS / MACHINE COLLABORATION
panel_6 = Panel("")
p_phase = Panel(num_2)
# PHASE 1 (50p)- NO HUMANS
panel_7 = Panel("")
p_phase_2 = Panel(num)

# ---- group: All Blocks for Pods / Units Planes
bang_3 = ExplodeTree(Data=pt)  # -> Branch0, Branch1, Branch2

# ----
area = Area(Geometry=bang_2.Branch1)  # -> Area, Centroid
prox = Proximity3D(Points=area.Centroid, Group="2", MaxRadius="5")  # -> simplify(Links), Topology
clean = CleanTree(RemoveNulls=True, RemoveInvalid=True, RemoveEmpty=True, Tree=prox.Links)
tstat = TreeStatistics(Tree=clean)  # -> Paths, Length, Count
duplines = RemoveDuplicateLines(Lines=flatten(clean), Tolerance=0.01)  # -> graft(Lines)
split = SplitTree(Data=simplify(graft(bang_2.Branch1)), Masks=flatten(tstat.Paths))  # -> graft(Positive), flatten(Negative)

# ----
# ADD UNITS FLOOR
# ASSEMBLY PHASE 2
panel_8 = Panel("Floors")
reflay_3 = ReferenceByLayer(LayerName=panel_8, lightweight=False, DisableAutoUpdate=False)
mesh = MeshBrep(
    Brep=reflay_3,
    Settings={GridMaxCount=0, GridMinCount=16, JaggedSeams=False, MaxEdgeLength=0, MinEdgeLength=0.0001, MinTolerance=0, Refine=True, RefineAngle=0, RelativeTolerance=0.65, SimplePlanes=True, Tolerance=0})
mjoin = MeshJoin(Meshes=mesh)
weld = WeldMesh(Mesh=mjoin, Angle=3.141592654)
brep = Brep(reflay_3)
filter = StreamFilter(Gate=list, Stream0=brep, Stream1=weld)
aphase = Panel(num_9)
name = ExtendSpeckleObject(
    SpeckleObject=filter,
    BIMSCPROJECT=bimsc_project,
    BIMSCORIGINATOR=bimsc_originator,
    BIMSCVOLUME=bimsc_volume,
    BIMSCTYPE="FLOORS",
    BIMSCMATERIAL="Regolith",
    RenderMaterial=dso.Regolith,
    BIMSCASSEMBLY=aphase,
    BIMSCPHASE=p_phase_2,
    selectedKitName="Objects")  # -> flatten(ExtendedSpeckleObject)

# ----
# ADD COURTYARD PODS
# ASSEMBLY PHASE 3
panel_9 = Panel("Pods")
reflay_4 = ReferenceByLayer(LayerName=panel_9, lightweight=False, DisableAutoUpdate=False)
mesh_2 = MeshBrep(
    Brep=reflay_4,
    Settings={GridMaxCount=0, GridMinCount=16, JaggedSeams=False, MaxEdgeLength=0, MinEdgeLength=0.0001, MinTolerance=0, Refine=True, RefineAngle=0, RelativeTolerance=0.65, SimplePlanes=True, Tolerance=0})
brep_2 = Brep(reflay_4)
mjoin_2 = MeshJoin(Meshes=mesh_2)
weld_2 = WeldMesh(Mesh=mjoin_2, Angle=3.141592654)
filter_2 = StreamFilter(Gate=list, Stream0=brep_2, Stream1=weld_2)
aphase_2 = Panel(num_10)
name_2 = ExtendSpeckleObject(
    SpeckleObject=filter_2,
    BIMSCPROJECT=bimsc_project,
    BIMSCORIGINATOR=bimsc_originator,
    BIMSCVOLUME=bimsc_volume,
    BIMSCTYPE="PODS",
    BIMSCMATERIAL="Regolith",
    RenderMaterial=dso.Regolith,
    BIMSCASSEMBLY=aphase_2,
    BIMSCPHASE=p_phase_2,
    selectedKitName="Objects")  # -> flatten(ExtendedSpeckleObject)

# ----
# ADD WALLS
# ASSEMBLY PHASE 4
panel_10 = Panel("Wall")
reflay_5 = ReferenceByLayer(LayerName=panel_10, lightweight=False, DisableAutoUpdate=False)
mesh_3 = MeshBrep(
    Brep=reflay_5,
    Settings={GridMaxCount=0, GridMinCount=16, JaggedSeams=False, MaxEdgeLength=0, MinEdgeLength=0.0001, MinTolerance=0, Refine=True, RefineAngle=0, RelativeTolerance=0.65, SimplePlanes=True, Tolerance=0})
brep_3 = Brep(reflay_5)
mjoin_3 = MeshJoin(Meshes=mesh_3)
weld_3 = WeldMesh(Mesh=mjoin_3, Angle=3.141592654)
filter_3 = StreamFilter(Gate=list, Stream0=brep_3, Stream1=weld_3)  # -> reverse(simplify(graft(Stream)))
aphase_3 = Panel(num_11)
name_3 = ExtendSpeckleObject(
    SpeckleObject=filter_3,
    BIMSCPROJECT=bimsc_project,
    BIMSCORIGINATOR=bimsc_originator,
    BIMSCVOLUME=bimsc_volume,
    BIMSCTYPE="WALLS",
    BIMSCMATERIAL="Regolith",
    RenderMaterial=dso.Regolith,
    BIMSCASSEMBLY=aphase_3,
    BIMSCPHASE=p_phase,
    selectedKitName="Objects")

# ----
# ADD ROOF
# ASSEMBLY PHASE 8
panel_11 = Panel("Roof")
reflay_6 = ReferenceByLayer(LayerName=panel_11, lightweight=False, DisableAutoUpdate=False)
mesh_4 = Mesh(reflay_6)
faceb = FaceBoundaries(Mesh=mesh_4)
boundary = BoundarySurfaces(Edges=faceb)
join = BrepJoin(Breps=boundary)  # -> Breps, Closed
mesh_5 = Mesh(reflay_6)
aphase_4 = Panel(num_15)
filter_4 = StreamFilter(Gate=list, Stream0=join.Breps, Stream1=mesh_5)  # -> reverse(simplify(graft(Stream)))
name_4 = ExtendSpeckleObject(
    SpeckleObject=filter_4,
    BIMSCPROJECT=bimsc_project,
    BIMSCORIGINATOR=bimsc_originator,
    BIMSCVOLUME=bimsc_volume,
    BIMSCTYPE="ROOF",
    BIMSCMATERIAL="Inflatable",
    RenderMaterial=dso.Inflatable,
    BIMSCASSEMBLY=aphase_4,
    BIMSCPHASE=p_phase,
    selectedKitName="Objects")

# ----
# SORTING UNITS BY VOLUME
end = EndPoints(Curve=simplify(duplines))  # -> Start, End
pdecon = Deconstruct(Point=[end.Start, end.End])  # -> XComponent, YComponent, ZComponent
int_2 = Integer(pdecon.ZComponent)
bnd = Bounds(Numbers=int_2)
dedomain = DeconstructDomain(Domain=bnd)  # -> Start, End
equals = Equality(FirstNumber=int_2, SecondNumber=dedomain.Start)  # -> Equality, Inequality
volume_2 = Volume(Geometry=split.Positive)  # -> Volume, simplify(flatten(Centroid))
cull = CullPattern(List=[end.Start, end.End], CullPattern=equals.Equality)
cp = ClosestPoint(Point=cull, Cloud=volume_2.Centroid)  # -> ClosestPoint, CPIndex, Distance
item_4 = ListItem(List=flatten(split.Positive), Index=cp.CPIndex, Wrap=True)
debrep = DeconstructBrep(Brep=item_4)  # -> Faces, Edges, Vertices
area_2 = Area(Geometry=debrep.Faces)  # -> Area, Centroid
pdecon_2 = Deconstruct(Point=area_2.Centroid)  # -> XComponent, YComponent, ZComponent
int_3 = Integer(pdecon_2.ZComponent)
bnd_2 = Bounds(Numbers=int_3)
dedomain_2 = DeconstructDomain(Domain=bnd_2)  # -> Start, End
equals_2 = Equality(FirstNumber=int_3, SecondNumber=dedomain_2.Start)  # -> Equality, Inequality
cull_2 = CullPattern(List=debrep.Faces, CullPattern=equals_2.Equality)  # -> simplify(List)
subtraction = Subtraction(A=dedomain.Start, B=dedomain.End)
wires = BrepWireframe(Brep=cull_2, Density=-1)
division = Division(A=subtraction, B="2")
abs = Absolute(Value=subtraction)
Z = UnitZ(Factor=division)
move = Move(Geometry=cull, Motion=Z)  # -> Geometry, Transform
project = Project(Geometry=wires, Plane=move.Geometry)  # -> simplify(Geometry), Transform

aphase_5 = Panel(num_13)
a_phase = Panel(num_8)

# ----
# EDIT SITE MESH
# ASSEMBLY PHASE 1
panel_12 = Panel("https://macad.speckle.xyz/streams/4975f9f0a8/branches/site/04-community-site")
receive_2 = Receive(
    Stream=panel_12,
    AutoReceive=False,
    CurrentComponentState="up_to_date",
    ExpandOutput=True,
    LastInfoMessage="James McBennett @ 03/01/2024 23:14:17: 2024 Mar-01 (id:9ec35295b2)",
    ReceiveOnOpen=False,
    ReceivedCommitId="9ec35295b2",
    StreamWrapper="https://macad.speckle.xyz/projects/4975f9f0a8/models/site/04-community-site",
    selectedKitName="Objects")  # -> Info, CONTOURS, SOIL
item_5 = ListItem(List=flatten(receive_2.SOIL), Index=Slider(3, range=0..17), Wrap=True)
srf = Surface(<surface referenced from the Rhino model>)
bbox = BoundingBox(Content=srf, Plane=PlaneXY(0, 0, 0))  # -> Box, Box_2
volume_3 = Volume(Geometry=bbox.Box)  # -> Volume, Centroid
msphere = MeshSphere(Base=volume_3.Centroid, Radius="80", UCount="100", VCount="100")
msplit = MeshSplit(Mesh=item_5, Splitters=msphere)
item_6 = ListItem(List=msplit, Index=Slider(0, range=0..1), Wrap=True)
name_5 = ExtendSpeckleObject(
    SpeckleObject=item_6,
    BIMSCPROJECT=bimsc_project,
    BIMSCORIGINATOR=bimsc_originator,
    BIMSCVOLUME=bimsc_volume,
    BIMSCTYPE="SITE",
    BIMSCMATERIAL="soil",
    RenderMaterial=dso.Site,
    BIMSCASSEMBLY=a_phase,
    BIMSCPHASE=p_phase_2,
    selectedKitName="Objects")  # -> flatten(ExtendedSpeckleObject)

# ----
# ADD SITE TERRAIN
# ASSEMBLY PHASE 1
panel_13 = Panel("TopoMesh")
reflay_7 = ReferenceByLayer(LayerName="TopoBrep", lightweight=False, DisableAutoUpdate=False)
reflay_8 = ReferenceByLayer(LayerName=panel_13, lightweight=False, DisableAutoUpdate=False)
filter_5 = StreamFilter(Gate=list, Stream0=reflay_7, Stream1=reflay_8)
msplit_2 = MeshSplit(Mesh=filter_5, Splitters=msphere)
item_7 = ListItem(List=msplit_2, Index=Slider(1, range=0..1), Wrap=True)
name_6 = ExtendSpeckleObject(
    SpeckleObject=item_7,
    BIMSCPROJECT=bimsc_project,
    BIMSCORIGINATOR=bimsc_originator,
    BIMSCVOLUME=bimsc_volume,
    BIMSCTYPE="TERRAIN",
    BIMSCMATERIAL="soil",
    RenderMaterial=dso.Soil,
    BIMSCASSEMBLY=a_phase,
    BIMSCPHASE=p_phase_2,
    selectedKitName="Objects")  # -> flatten(ExtendedSpeckleObject)

end_2 = EndPoints(Curve=project.Geometry)  # -> Start, End
multiplication = Multiplication(A=abs, B="2")
cullpt = CullDuplicates(Points=[end_2.Start, end_2.End], Tolerance=0.1, CullMode=3)  # -> Points, Indices, Valence
pline = PolyLine(Vertices=cullpt.Points, Closed=True)  # -> simplify(Polyline)
Z_2 = UnitZ(Factor=multiplication)
extr = Extrude(Base=pline, Direction=Z_2)
cap = CapHoles(Brep=extr)

# ---- group: Units_Buffer
# UNITS PLANES
debrep_2 = DeconstructBrep(Brep=bang_2.Branch0)  # -> Faces, Edges, Vertices
area_3 = Area(Geometry=debrep_2.Faces)  # -> Area, Centroid
pdecon_3 = Deconstruct(Point=area_3.Centroid)  # -> XComponent, YComponent, ZComponent
int_4 = Integer(pdecon_3.ZComponent)
bnd_3 = Bounds(Numbers=int_4)
dedomain_3 = DeconstructDomain(Domain=bnd_3)  # -> Start, End
equals_3 = Equality(FirstNumber=int_4, SecondNumber=dedomain_3.Start)  # -> Equality, Inequality
cull_3 = CullPattern(List=area_3.Centroid, CullPattern=equals_3.Equality)  # -> simplify(List)
pln = Plane(flatten(cull_3))

pln_2 = Plane(flatten(cull_3))

# ---- group: Units_Support
debrep_3 = DeconstructBrep(Brep=cap)  # -> Faces, Edges, Vertices
area_4 = Area(Geometry=debrep_3.Faces)  # -> Area, Centroid
pdecon_4 = Deconstruct(Point=area_4.Centroid)  # -> XComponent, YComponent, ZComponent
int_5 = Integer(pdecon_4.ZComponent)
bnd_4 = Bounds(Numbers=int_5)
dedomain_4 = DeconstructDomain(Domain=bnd_4)  # -> Start, End
equals_4 = Equality(FirstNumber=int_5, SecondNumber=dedomain_4.Start)  # -> Equality, Inequality
cull_4 = CullPattern(List=area_4.Centroid, CullPattern=equals_4.Equality)  # -> simplify(List)
pln_3 = Plane(flatten(cull_4))

pln_4 = Plane(flatten(cull_4))

# ----
# BUFFER UNITS
# ASSEMBLY PHASE 5
expblock = ExplodeBlock(Block=bang.Branch0, recursive=False)  # -> Name, Transform, Geometry
detatt = DetachAttributes(Geometry=expblock.Geometry)  # -> Geometry, Attributes
ef_att = EleFrontAttributes(Attributes=detatt.Attributes)
ef_layer = EleFrontLayer(Layer=ef_att)
cset_3 = CreateSet(List=ef_layer)  # -> Set, Map
cset_4 = CreateSet(List=cset_3.Map)  # -> Set, Map
mindex_2 = MemberIndex(Set=cset_3.Map, Member=cset_4.Set)  # -> Index, Count
item_8 = ListItem(List=detatt.Geometry, Index=mindex_2.Index, Wrap=True)  # -> simplify(Item)
bang_4 = ExplodeTree(Data=item_8)  # -> Branch0, Branch1, Branch2, Branch3, Branch4, Branch5, Branch6, Branch7
aphase_6 = Panel(num_12)
orient = Orient(Geometry=bang.Branch0, Source=bang_3.Branch0, Target=pln_4)  # -> Geometry, Transform
sso = BlockDefinition(
    Name="Roof",
    Geometry=bang_4.Branch6,
    BasePoint=bang_3.Branch0,
    SelectedConstructorName="Objects.Other.BlockDefinition.ctor(System.String,System.Collections.Generic.List`1[Speckle.Core.Models.Base],Objects.Geometry.Point)",
    SelectedTypeName="Objects.Other.BlockDefinition",
    UseSchemaTag=False,
    UserSetSchemaTag=False,
    seed="a6a926b6cdd9deac4119")
sso_2 = BlockDefinition(
    Name="Floors",
    Geometry=bang_4.Branch7,
    BasePoint=bang_3.Branch0,
    SelectedConstructorName="Objects.Other.BlockDefinition.ctor(System.String,System.Collections.Generic.List`1[Speckle.Core.Models.Base],Objects.Geometry.Point)",
    SelectedTypeName="Objects.Other.BlockDefinition",
    UseSchemaTag=False,
    UserSetSchemaTag=False,
    seed="89fbf44ba3c3c579cb90")
sso_3 = BlockDefinition(
    Name="Framing",
    Geometry=bang_4.Branch5,
    BasePoint=bang_3.Branch0,
    SelectedConstructorName="Objects.Other.BlockDefinition.ctor(System.String,System.Collections.Generic.List`1[Speckle.Core.Models.Base],Objects.Geometry.Point)",
    SelectedTypeName="Objects.Other.BlockDefinition",
    UseSchemaTag=False,
    UserSetSchemaTag=False,
    seed="b5cab1394e422085139f")
sso_4 = BlockDefinition(
    Name="Window",
    Geometry=bang_4.Branch4,
    BasePoint=bang_3.Branch0,
    SelectedConstructorName="Objects.Other.BlockDefinition.ctor(System.String,System.Collections.Generic.List`1[Speckle.Core.Models.Base],Objects.Geometry.Point)",
    SelectedTypeName="Objects.Other.BlockDefinition",
    UseSchemaTag=False,
    UserSetSchemaTag=False,
    seed="c3e00cf1e113ee790956")
sso_5 = BlockDefinition(
    Name="InflatableOuter",
    Geometry=bang_4.Branch0,
    BasePoint=bang_3.Branch0,
    SelectedConstructorName="Objects.Other.BlockDefinition.ctor(System.String,System.Collections.Generic.List`1[Speckle.Core.Models.Base],Objects.Geometry.Point)",
    SelectedTypeName="Objects.Other.BlockDefinition",
    UseSchemaTag=False,
    UserSetSchemaTag=False,
    seed="a06898b9aae7d5b59163")
sso_6 = BlockDefinition(
    Name="WindowFrames",
    Geometry=bang_4.Branch1,
    BasePoint=bang_3.Branch0,
    SelectedConstructorName="Objects.Other.BlockDefinition.ctor(System.String,System.Collections.Generic.List`1[Speckle.Core.Models.Base],Objects.Geometry.Point)",
    SelectedTypeName="Objects.Other.BlockDefinition",
    UseSchemaTag=False,
    UserSetSchemaTag=False,
    seed="bf22bfac7f0cb1c82614")
sso_7 = BlockDefinition(
    Name="InflatableMiddle",
    Geometry=bang_4.Branch2,
    BasePoint=bang_3.Branch0,
    SelectedConstructorName="Objects.Other.BlockDefinition.ctor(System.String,System.Collections.Generic.List`1[Speckle.Core.Models.Base],Objects.Geometry.Point)",
    SelectedTypeName="Objects.Other.BlockDefinition",
    UseSchemaTag=False,
    UserSetSchemaTag=False,
    seed="a891fcab42e3dcb01ead")
sso_8 = BlockDefinition(
    Name="InflatableInner",
    Geometry=bang_4.Branch3,
    BasePoint=bang_3.Branch0,
    SelectedConstructorName="Objects.Other.BlockDefinition.ctor(System.String,System.Collections.Generic.List`1[Speckle.Core.Models.Base],Objects.Geometry.Point)",
    SelectedTypeName="Objects.Other.BlockDefinition",
    UseSchemaTag=False,
    UserSetSchemaTag=False,
    seed="49d4bef7ec4954096c84")
sso_9 = BlockInstance(
    BlockDefinition=sso,
    Transform=orient.Transform,
    SelectedConstructorName="Objects.Other.BlockInstance.ctor(Objects.Other.BlockDefinition,Objects.Other.Transform)",
    SelectedTypeName="Objects.Other.BlockInstance",
    UseSchemaTag=False,
    UserSetSchemaTag=False,
    seed="d6813072dbc86d15dc5e")
sso_10 = BlockInstance(
    BlockDefinition=sso_2,
    Transform=orient.Transform,
    SelectedConstructorName="Objects.Other.BlockInstance.ctor(Objects.Other.BlockDefinition,Objects.Other.Transform)",
    SelectedTypeName="Objects.Other.BlockInstance",
    UseSchemaTag=False,
    UserSetSchemaTag=False,
    seed="e6e169834764c6c910e8")
sso_11 = BlockInstance(
    BlockDefinition=sso_3,
    Transform=orient.Transform,
    SelectedConstructorName="Objects.Other.BlockInstance.ctor(Objects.Other.BlockDefinition,Objects.Other.Transform)",
    SelectedTypeName="Objects.Other.BlockInstance",
    UseSchemaTag=False,
    UserSetSchemaTag=False,
    seed="18bf0c4c4f428973b0f0")
sso_12 = BlockInstance(
    BlockDefinition=sso_4,
    Transform=orient.Transform,
    SelectedConstructorName="Objects.Other.BlockInstance.ctor(Objects.Other.BlockDefinition,Objects.Other.Transform)",
    SelectedTypeName="Objects.Other.BlockInstance",
    UseSchemaTag=False,
    UserSetSchemaTag=False,
    seed="b29bcd91531f56f9eb1f")
sso_13 = BlockInstance(
    BlockDefinition=sso_5,
    Transform=orient.Transform,
    SelectedConstructorName="Objects.Other.BlockInstance.ctor(Objects.Other.BlockDefinition,Objects.Other.Transform)",
    SelectedTypeName="Objects.Other.BlockInstance",
    UseSchemaTag=False,
    UserSetSchemaTag=False,
    seed="6c22e30deca8216941c1")
sso_14 = BlockInstance(
    BlockDefinition=sso_6,
    Transform=orient.Transform,
    SelectedConstructorName="Objects.Other.BlockInstance.ctor(Objects.Other.BlockDefinition,Objects.Other.Transform)",
    SelectedTypeName="Objects.Other.BlockInstance",
    UseSchemaTag=False,
    UserSetSchemaTag=False,
    seed="f42b875f65374629faa6")
sso_15 = BlockInstance(
    BlockDefinition=sso_7,
    Transform=orient.Transform,
    SelectedConstructorName="Objects.Other.BlockInstance.ctor(Objects.Other.BlockDefinition,Objects.Other.Transform)",
    SelectedTypeName="Objects.Other.BlockInstance",
    UseSchemaTag=False,
    UserSetSchemaTag=False,
    seed="667008e3d6e681a5a372")
sso_16 = BlockInstance(
    BlockDefinition=sso_8,
    Transform=orient.Transform,
    SelectedConstructorName="Objects.Other.BlockInstance.ctor(Objects.Other.BlockDefinition,Objects.Other.Transform)",
    SelectedTypeName="Objects.Other.BlockInstance",
    UseSchemaTag=False,
    UserSetSchemaTag=False,
    seed="fb100785f681620c9359")
name_7 = ExtendSpeckleObject(
    SpeckleObject=sso_9,
    BIMSCPROJECT=bimsc_project,
    BIMSCORIGINATOR=bimsc_originator,
    BIMSCVOLUME=bimsc_volume,
    BIMSCTYPE="STRUCTURE",
    BIMSCMATERIAL="Steel",
    RenderMaterial=dso.Steel,
    BIMSCASSEMBLY=aphase_6,
    BIMSCPHASE=p_phase,
    selectedKitName="Objects")
name_8 = ExtendSpeckleObject(
    SpeckleObject=sso_10,
    BIMSCPROJECT=bimsc_project,
    BIMSCORIGINATOR=bimsc_originator,
    BIMSCVOLUME=bimsc_volume,
    BIMSCTYPE="STRUCTURE",
    BIMSCMATERIAL="Steel",
    RenderMaterial=dso.Steel,
    BIMSCASSEMBLY=aphase_6,
    BIMSCPHASE=p_phase,
    selectedKitName="Objects")
name_9 = ExtendSpeckleObject(
    SpeckleObject=sso_11,
    BIMSCPROJECT=bimsc_project,
    BIMSCORIGINATOR=bimsc_originator,
    BIMSCVOLUME=bimsc_volume,
    BIMSCTYPE="STRUCTURE",
    BIMSCMATERIAL="Steel",
    RenderMaterial=dso.Steel,
    BIMSCASSEMBLY=aphase_6,
    BIMSCPHASE=p_phase,
    selectedKitName="Objects")
name_10 = ExtendSpeckleObject(
    SpeckleObject=sso_12,
    BIMSCPROJECT=bimsc_project,
    BIMSCORIGINATOR=bimsc_originator,
    BIMSCVOLUME=bimsc_volume,
    BIMSCTYPE="GLASS",
    BIMSCMATERIAL="Glass",
    RenderMaterial=dso.Glass,
    BIMSCASSEMBLY=aphase_6,
    BIMSCPHASE=p_phase,
    selectedKitName="Objects")
name_11 = ExtendSpeckleObject(
    SpeckleObject=sso_13,
    BIMSCPROJECT=bimsc_project,
    BIMSCORIGINATOR=bimsc_originator,
    BIMSCVOLUME=bimsc_volume,
    BIMSCTYPE="Inflatable",
    BIMSCMATERIAL="Inflatable",
    RenderMaterial=dso.Inflatable,
    BIMSCASSEMBLY=aphase_6,
    BIMSCPHASE=p_phase,
    selectedKitName="Objects")
name_12 = ExtendSpeckleObject(
    SpeckleObject=sso_14,
    BIMSCPROJECT=bimsc_project,
    BIMSCORIGINATOR=bimsc_originator,
    BIMSCVOLUME=bimsc_volume,
    BIMSCTYPE="STRUCTURE",
    BIMSCMATERIAL="Steel",
    RenderMaterial=dso.Steel,
    BIMSCASSEMBLY=aphase_6,
    BIMSCPHASE=p_phase,
    selectedKitName="Objects")
name_13 = ExtendSpeckleObject(
    SpeckleObject=sso_15,
    BIMSCPROJECT=bimsc_project,
    BIMSCORIGINATOR=bimsc_originator,
    BIMSCVOLUME=bimsc_volume,
    BIMSCTYPE="Inflatable",
    BIMSCMATERIAL="Inflatable",
    RenderMaterial=dso.Inflatable,
    BIMSCASSEMBLY=aphase_6,
    BIMSCPHASE=p_phase,
    selectedKitName="Objects")
name_14 = ExtendSpeckleObject(
    SpeckleObject=sso_16,
    BIMSCPROJECT=bimsc_project,
    BIMSCORIGINATOR=bimsc_originator,
    BIMSCVOLUME=bimsc_volume,
    BIMSCTYPE="Inflatable",
    BIMSCMATERIAL="Inflatable",
    RenderMaterial=dso.Inflatable,
    BIMSCASSEMBLY=aphase_6,
    BIMSCPHASE=p_phase,
    selectedKitName="Objects")
in = CreateSpeckleObject(
    InflatableOuter=name_11,
    InflatableMiddle=name_13,
    InflatableInner=name_14,
    WindowFrames=name_12,
    Window=name_10,
    Framing=name_9,
    Roof=name_7,
    Floors=name_8,
    selectedKitName="Objects")

# ---- group: Units_Habi
debrep_4 = DeconstructBrep(Brep=split.Negative)  # -> Faces, Edges, Vertices
area_5 = Area(Geometry=debrep_4.Faces)  # -> Area, Centroid
pdecon_5 = Deconstruct(Point=area_5.Centroid)  # -> XComponent, YComponent, ZComponent
int_6 = Integer(pdecon_5.ZComponent)
bnd_5 = Bounds(Numbers=int_6)
dedomain_5 = DeconstructDomain(Domain=bnd_5)  # -> Start, End
equals_5 = Equality(FirstNumber=int_6, SecondNumber=dedomain_5.Start)  # -> Equality, Inequality
cull_5 = CullPattern(List=area_5.Centroid, CullPattern=equals_5.Equality)  # -> simplify(List)
pln_5 = Plane(flatten(cull_5))

pln_6 = Plane(flatten(cull_5))

# ----
# HABITAD UNITS
# ASSEMBLY PHASE 6
expblock_2 = ExplodeBlock(Block=bang.Branch0, recursive=False)  # -> Name, Transform, Geometry
detatt_2 = DetachAttributes(Geometry=expblock_2.Geometry)  # -> Geometry, Attributes
volume_4 = Volume(Geometry=detatt_2.Geometry)  # -> Volume, Centroid
cset_5 = CreateSet(List=volume_4.Volume)  # -> Set, Map
cset_6 = CreateSet(List=cset_5.Map)  # -> Set, Map
mindex_3 = MemberIndex(Set=cset_5.Map, Member=cset_6.Set)  # -> Index, Count
item_9 = ListItem(List=detatt_2.Geometry, Index=mindex_3.Index, Wrap=True)  # -> simplify(Item)
bang_5 = ExplodeTree(Data=item_9)  # -> Branch0, Branch1, Branch2
sso_17 = BlockDefinition(
    Name="Glass",
    Geometry=bang_5.Branch2,
    SelectedConstructorName="Objects.Other.BlockDefinition.ctor(System.String,System.Collections.Generic.List`1[Speckle.Core.Models.Base],Objects.Geometry.Point)",
    SelectedTypeName="Objects.Other.BlockDefinition",
    UseSchemaTag=False,
    UserSetSchemaTag=False,
    seed="ff8e895b96f4344e5bea")
sso_18 = BlockDefinition(
    Name="Inflatable",
    Geometry=bang_5.Branch1,
    BasePoint=bang_3.Branch0,
    SelectedConstructorName="Objects.Other.BlockDefinition.ctor(System.String,System.Collections.Generic.List`1[Speckle.Core.Models.Base],Objects.Geometry.Point)",
    SelectedTypeName="Objects.Other.BlockDefinition",
    UseSchemaTag=False,
    UserSetSchemaTag=False,
    seed="74c7ac9f915255a3e209")
sso_19 = BlockDefinition(
    Name="Steel",
    Geometry=bang_5.Branch0,
    BasePoint=bang_3.Branch0,
    SelectedConstructorName="Objects.Other.BlockDefinition.ctor(System.String,System.Collections.Generic.List`1[Speckle.Core.Models.Base],Objects.Geometry.Point)",
    SelectedTypeName="Objects.Other.BlockDefinition",
    UseSchemaTag=False,
    UserSetSchemaTag=False,
    seed="6d6048d8a75f62682faf")
orient_2 = Orient(Geometry=bang.Branch0, Source=bang_3.Branch0, Target=pln_6)  # -> Geometry, Transform
sso_20 = BlockInstance(
    BlockDefinition=sso_17,
    Transform=orient_2.Transform,
    SelectedConstructorName="Objects.Other.BlockInstance.ctor(Objects.Other.BlockDefinition,Objects.Other.Transform)",
    SelectedTypeName="Objects.Other.BlockInstance",
    UseSchemaTag=False,
    UserSetSchemaTag=False,
    seed="741531741e3be19cb2c0")
sso_21 = BlockInstance(
    BlockDefinition=sso_18,
    Transform=orient_2.Transform,
    SelectedConstructorName="Objects.Other.BlockInstance.ctor(Objects.Other.BlockDefinition,Objects.Other.Transform)",
    SelectedTypeName="Objects.Other.BlockInstance",
    UseSchemaTag=False,
    UserSetSchemaTag=False,
    seed="5ef6fa26b8afc923a02a")
sso_22 = BlockInstance(
    BlockDefinition=sso_19,
    Transform=orient_2.Transform,
    SelectedConstructorName="Objects.Other.BlockInstance.ctor(Objects.Other.BlockDefinition,Objects.Other.Transform)",
    SelectedTypeName="Objects.Other.BlockInstance",
    UseSchemaTag=False,
    UserSetSchemaTag=False,
    seed="2b6654ad513ddd9dd323")
name_15 = ExtendSpeckleObject(
    SpeckleObject=sso_20,
    BIMSCPROJECT=bimsc_project,
    BIMSCORIGINATOR=bimsc_originator,
    BIMSCVOLUME=bimsc_volume,
    BIMSCTYPE="STRUCTURE",
    BIMSCMATERIAL="Glass",
    RenderMaterial=dso.Glass,
    BIMSCASSEMBLY=aphase_5,
    BIMSCPHASE=p_phase,
    selectedKitName="Objects")
name_16 = ExtendSpeckleObject(
    SpeckleObject=sso_21,
    BIMSCPROJECT=bimsc_project,
    BIMSCORIGINATOR=bimsc_originator,
    BIMSCVOLUME=bimsc_volume,
    BIMSCTYPE="INFLATABLES",
    BIMSCMATERIAL="Inflatable",
    RenderMaterial=dso.Inflatable,
    BIMSCASSEMBLY=aphase_5,
    BIMSCPHASE=p_phase,
    selectedKitName="Objects")
name_17 = ExtendSpeckleObject(
    SpeckleObject=sso_22,
    BIMSCPROJECT=bimsc_project,
    BIMSCORIGINATOR=bimsc_originator,
    BIMSCVOLUME=bimsc_volume,
    BIMSCTYPE="STRUCTURE",
    BIMSCMATERIAL="Steel",
    RenderMaterial=dso.Steel,
    BIMSCASSEMBLY=aphase_5,
    BIMSCPHASE=p_phase,
    selectedKitName="Objects")
in_2 = CreateSpeckleObject(Inflatables=name_16, Structure=name_17, Window=name_15, selectedKitName="Objects")

# ----
# SUPPORT UNITS
# ASSEMBLY PHASE 7
expblock_3 = ExplodeBlock(recursive=False)  # -> Name, Transform, Geometry
detatt_3 = DetachAttributes(Geometry=expblock_3.Geometry)  # -> Geometry, Attributes
volume_5 = Volume(Geometry=detatt_3.Geometry)  # -> Volume, Centroid
cset_7 = CreateSet(List=volume_5.Volume)  # -> Set, Map
cset_8 = CreateSet(List=cset_7.Map)  # -> Set, Map
mindex_4 = MemberIndex(Set=cset_7.Map, Member=cset_8.Set)  # -> Index, Count
item_10 = ListItem(List=detatt_3.Geometry, Index=mindex_4.Index, Wrap=True)  # -> simplify(Item)
bang_6 = ExplodeTree(Data=item_10)  # -> Branch0, Branch1, Branch2
sso_23 = BlockDefinition(
    Name="Glass",
    Geometry=bang_6.Branch2,
    SelectedConstructorName="Objects.Other.BlockDefinition.ctor(System.String,System.Collections.Generic.List`1[Speckle.Core.Models.Base],Objects.Geometry.Point)",
    SelectedTypeName="Objects.Other.BlockDefinition",
    UseSchemaTag=False,
    UserSetSchemaTag=False,
    seed="c00390b6159f8939e4fd")
sso_24 = BlockDefinition(
    Name="Inflatable",
    Geometry=bang_6.Branch1,
    SelectedConstructorName="Objects.Other.BlockDefinition.ctor(System.String,System.Collections.Generic.List`1[Speckle.Core.Models.Base],Objects.Geometry.Point)",
    SelectedTypeName="Objects.Other.BlockDefinition",
    UseSchemaTag=False,
    UserSetSchemaTag=False,
    seed="e98ffe5e9bfe795355b2")
sso_25 = BlockDefinition(
    Name="Steel",
    Geometry=bang_6.Branch0,
    SelectedConstructorName="Objects.Other.BlockDefinition.ctor(System.String,System.Collections.Generic.List`1[Speckle.Core.Models.Base],Objects.Geometry.Point)",
    SelectedTypeName="Objects.Other.BlockDefinition",
    UseSchemaTag=False,
    UserSetSchemaTag=False,
    seed="19cce9d17a2992b002e5")
orient_3 = Orient(Source=PlaneXY(0, 0, 0), Target=pln_2)  # -> Geometry, Transform
aphase_7 = Panel(num_14)
sso_26 = BlockInstance(
    BlockDefinition=sso_23,
    Transform=orient_3.Transform,
    SelectedConstructorName="Objects.Other.BlockInstance.ctor(Objects.Other.BlockDefinition,Objects.Other.Transform)",
    SelectedTypeName="Objects.Other.BlockInstance",
    UseSchemaTag=False,
    UserSetSchemaTag=False,
    seed="95800f53cba6afedca5a")
sso_27 = BlockInstance(
    BlockDefinition=sso_24,
    Transform=orient_3.Transform,
    SelectedConstructorName="Objects.Other.BlockInstance.ctor(Objects.Other.BlockDefinition,Objects.Other.Transform)",
    SelectedTypeName="Objects.Other.BlockInstance",
    UseSchemaTag=False,
    UserSetSchemaTag=False,
    seed="6ac40892a254094ba5bf")
sso_28 = BlockInstance(
    BlockDefinition=sso_25,
    Transform=orient_3.Transform,
    SelectedConstructorName="Objects.Other.BlockInstance.ctor(Objects.Other.BlockDefinition,Objects.Other.Transform)",
    SelectedTypeName="Objects.Other.BlockInstance",
    UseSchemaTag=False,
    UserSetSchemaTag=False,
    seed="56e02fcb1ef79a18a3fe")
name_18 = ExtendSpeckleObject(
    SpeckleObject=sso_26,
    BIMSCPROJECT=bimsc_project,
    BIMSCORIGINATOR=bimsc_originator,
    BIMSCVOLUME=bimsc_volume,
    BIMSCTYPE="STRUCTURE",
    BIMSCMATERIAL="Glass",
    RenderMaterial=dso.Glass,
    BIMSCASSEMBLY=aphase_7,
    BIMSCPHASE=p_phase,
    selectedKitName="Objects")
name_19 = ExtendSpeckleObject(
    SpeckleObject=sso_27,
    BIMSCPROJECT=bimsc_project,
    BIMSCORIGINATOR=bimsc_originator,
    BIMSCVOLUME=bimsc_volume,
    BIMSCTYPE="INFLATABLES",
    BIMSCMATERIAL="Inflatable",
    RenderMaterial=dso.Inflatable,
    BIMSCASSEMBLY=aphase_7,
    BIMSCPHASE=p_phase,
    selectedKitName="Objects")
name_20 = ExtendSpeckleObject(
    SpeckleObject=sso_28,
    BIMSCPROJECT=bimsc_project,
    BIMSCORIGINATOR=bimsc_originator,
    BIMSCVOLUME=bimsc_volume,
    BIMSCTYPE="STRUCTURE",
    BIMSCMATERIAL="Steel",
    RenderMaterial=dso.Steel,
    BIMSCASSEMBLY=aphase_7,
    BIMSCPHASE=p_phase,
    selectedKitName="Objects")
in_3 = CreateSpeckleObject(Inflatables=name_19, Structure=name_20, Window=name_18, selectedKitName="Objects")

# ----
# MERGED UNITS
in_4 = CreateSpeckleObject(Units_Buffer=in, Units_Habi=in_2, Units_Support=in_3, selectedKitName="Objects")

# ----
# 01 //Create Revit Materials from Rhino M Properties
trigger = Trigger(Interval=-1000, TimerInterval=1000, Target=[material, graphics])  # disabled

# ----
# 02// Create New Unit Revit Family
trigger_2 = Trigger(Interval=-1000, TimerInterval=1000, Target=[new, famform, materials, active])  # disabled

# ----
# SEND TO REVIT MODEL
# The figures in the circles from the trigger component
# for the revit families to work have to be from left to right:
# a triangle (play), a pointer (mouse), and a key.
# //Send Topo Meshes to Revit
trigger_3 = Trigger(Interval=-1000, TimerInterval=1000, Target=topography)  # disabled

# ----
# 03//Add Units to Revit
trigger_4 = Trigger(Interval=-1000, TimerInterval=1000, Target=[types, l_component, l_component_2, l_component_3])  # disabled

# ----
# G06 wip branch
panel_14 = Panel("G06_WIPdModel_V18")
panel_15 = Panel("https://macad.speckle.xyz/projects/4975f9f0a8/models/0c407c0907")

# ----
# G06 shared branch
# https://macad.speckle.xyz/projects/4975f9f0a8/models/37a2354197
panel_16 = Panel("G06_AssembledModel_V10")

# ----
# G06_test_Unreal
# https://macad.speckle.xyz/streams/5e4e4e4563
panel_17 = Panel("G06_UnrealdModel_V1")

# ----
# G6_STUDIO_MAIN_MODEL
# https://macad.speckle.xyz/projects/4975f9f0a8/models/37a2354197
panel_18 = Panel("G06_AssembledModel_V4")

# ----
# SEND TO SPLECKLE STREAMS
cso = CreateSpeckleObject(ROOF=name_4, WALL=name_3, FLOORS=name, PODS=name_2, UNITS=in, TERRAIN=name_6, SITE_A4=name_5, selectedKitName="Objects")

# ----
# Always Leave Send Component Unplugged
# in the stream input before closing and
# saving this gh file
send = Send(
    Stream=panel_15,
    Message=panel_14,
    D=cso,
    AutoSend=False,
    BaseId="9413ebc4002288f4c042c3580a2c2ffb",
    CurrentComponentState="up_to_date",
    KitName="Objects",
    OutputWrappers="https://macad.speckle.xyz\t4975f9f0a8\tc4be81f554",
    UseDefaultCache=True,
    selectedKitName="Objects")
rec = DataRecorder(send, DataLimit=-10, RecordData=True)
panel_19 = Panel(rec)

# ----
# //Send topo meshes to Revit
number_slider_3 = Slider(9, range=0..10)
mesh_6 = Mesh(reflay_8)
unweld = UnweldMesh(Mesh=mesh_6, Angle=degrees(number_slider_3))
topography = AddTopographyMesh(Mesh=unweld, TrackingMode=2)  # disabled

# ----
# //Send block instances to Revit
block_info_2 = GetBlockInfo(Block=reflay)  # -> Name, Plane, Transform, BlockType, FilePath, Active
orient_4 = Orient(Geometry=reflay, Source=block_info_2.Plane, Target=PlaneXY(0, 0, 0))  # -> Geometry, Transform
expblock_4 = ExplodeBlock(Block=orient_4.Geometry, recursive=False)  # -> Name, Transform, Geometry

# ----
# //Query materials' names using Elefront
geo = Geometry(expblock_4.Geometry)
ef_att_2 = EleFrontAttributes(Attributes=geo)
ef_layer_2 = EleFrontLayer(Layer=ef_att_2)
ef_layer_3 = EleFrontLayer(Layer=ef_layer_2)

split_2 = TextSplit(Text=ef_layer_2, Separators="::")
item_11 = ListItem(List=split_2, Index=-1, Wrap=True)
concat_2 = Concatenate(FragmentA="M-", FragmentB=item_11)  # -> simplify(Result)
pshift = ShiftPaths(Data=concat_2, Offset=-1)

# ----
# 02// Create new component family
materials = QueryMaterials(Name=pshift)
add_link_to_revit_family_in_from_your_la = Panel("C:\Users\ARoncal\OneDrive - Thornton Tomasetti, Inc\__License Resources\Desktop\G06_studio_2024\Final\documentation\FTemplate_GEN_.rft")  # "Add Link to Revit Family in from your laptop. [Final / Documentation]"
famform = ComponentFamilyForm(Brep=graft(geo), Material=materials)
active = ActiveDocument()
shift = ShiftPaths(Data=famform, Offset=-1)
new = NewComponentFamily(
    Document=active,
    Template=add_link_to_revit_family_in_from_your_la,
    Overwrite=Toggle(True),
    Name=simplify(expblock_4.Name),
    Geometry=simplify(shift))

# ----
# 03//Add components to RH Planes
types = QueryTypes(Document=active, Kind=3, FamilyName=expblock_4.Name)
bang_7 = ExplodeTree()  # -> Branch0, Branch1, Branch2
l_component = AddComponentLocation(Document=active, Location=simplify(pln), Type=simplify(bang_7.Branch0), TrackingMode=2)
l_component_2 = AddComponentLocation(Document=active, Location=simplify(pln_5), Type=simplify(bang_7.Branch1), TrackingMode=2)
l_component_3 = AddComponentLocation(Document=active, Location=simplify(pln_3), Type=simplify(bang_7.Branch2), TrackingMode=2)

# ----
# 01 //Create Revit materials from Rhino M Properties
cset_9 = CreateSet(List=flatten(pshift))  # -> Set, Map
material = AddMaterial(Name=cset_9.Set, TrackingMode=2)  # disabled

# ---- group: MaterialProperties
python = GhPythonScript(Mname=cset_9.Set)  # -> out, Pvalue, Pname
# ---------- python: Python ----------
__author__ = "hesham.shawqy"
__version__ = "2024.02.25"

import rhinoscriptsyntax as rs
import Rhino.DocObjects as rd
import Rhino as rh

def get_material_properties(Mname):
    # Get the active Rhino document
    doc = rh.RhinoDoc.ActiveDoc
    
    # Search for the material by name
    material_index = doc.Materials.Find(Mname, True)
    if material_index < 0:
        print("Material not found.")
        return None
    
    # Retrieve the material object
    material = doc.Materials[material_index]
    
    # Extract material properties
    properties = {
        "DiffuseColor": material.DiffuseColor,
        "Transparency": material.Transparency,
        # Add more properties as needed
    }
    
    return properties

Pname = []
Pvalue = []
material_properties = get_material_properties(Mname)
if material_properties:
    for prop, value in material_properties.items():
        Pvalue.append(value)
        Pname.append(prop)
# ---------- end python ----------

# ----
item_12 = ListItem(List=simplify(python.Pvalue), Index=0, Wrap=True)  # -> Item, Item1
graphics = MaterialGraphics(
    Material=simplify(graft(material)),
    Color=item_12.Item,
    Transparency=item_12.Item1,
    ForegroundPatternCutPatterns=<geometry referenced from the Revit model>)  # -> Material, UseRenderAppearance, Color, Transparency, SurfacePatternsForegroundPattern, SurfacePatternsForegroundColor, CutPatternsForegroundPattern, CutPatternsForegroundColor; disabled
